# Grasshopper definition dynamicWave.gh (Grasshopper 1.0.4)

dimensions = Slider(300, range=300..400)
nodes = Slider(5, range=2..10)
amplitude = Slider(-22.496, range=-50..50)
nodes_2 = Slider(3, range=2..10)
amplitude_2 = Slider(27.138, range=-50..50)
detail = Slider(13, range=3..15)
rotate = Slider(-0.46, range=-6..6)
rotate_2 = Slider(0.67, range=-6..6)
rotate_3 = Slider(-4.14, range=-6..6)
set_one_point_here = Point(<point referenced from the Rhino model>)
X = UnitX(Factor=dimensions)
move = Move(Geometry=set_one_point_here, Motion=X)  # -> Geometry, Transform
pt = Point(set_one_point_here)
ln = Line(StartPoint=move.Geometry, EndPoint=set_one_point_here)
Z = UnitZ(Factor=dimensions)
move_2 = Move(Geometry=pt, Motion=Z)  # -> Geometry, Transform
X_2 = UnitX(Factor=dimensions)
move_3 = Move(Geometry=move_2.Geometry, Motion=X_2)  # -> Geometry, Transform
ln_2 = Line(StartPoint=move_3.Geometry, EndPoint=move_2.Geometry)
divide = DivideCurve(Curve=ln_2, Count=nodes_2, Kinks=False)  # -> Points, Tangents, Parameters
divide_2 = DivideCurve(Curve=ln, Count=nodes, Kinks=False)  # -> Points, Tangents, Parameters
panel = Panel(divide.Points)
panel_2 = Panel(divide_2.Points)
dispatch = Dispatch(List=panel, DispatchPattern=[True, False])  # -> ListA, ListB
dispatch_2 = Dispatch(List=panel_2, DispatchPattern=[True, False])  # -> ListA, ListB
panel_3 = Panel(dispatch.ListB)
panel_4 = Panel(dispatch_2.ListB)
panel_5 = Panel(dispatch.ListA)
panel_6 = Panel(dispatch_2.ListA)
odd_points = Point(panel_5)
even_points = Point(panel_3)
odd_points_2 = Point(panel_6)
even_points_2 = Point(panel_4)
Y = UnitY(Factor=[amplitude, amplitude_2])
Y_2 = UnitY(Factor=amplitude)
number = Number(-1)
multiplication = Multiplication(A=amplitude_2, B=number)
Y_3 = UnitY(Factor=multiplication)
number_2 = Number(-1)
multiplication_2 = Multiplication(A=amplitude, B=number_2)
Y_4 = UnitY(Factor=multiplication_2)
move_4 = Move(Geometry=even_points, Motion=Y_3)  # -> Geometry, Transform
move_5 = Move(Geometry=even_points_2, Motion=Y_4)  # -> Geometry, Transform
move_6 = Move(Geometry=odd_points, Motion=Y)  # -> Geometry, Transform
move_7 = Move(Geometry=odd_points_2, Motion=Y_2)  # -> Geometry, Transform
sort_pt = SortPoints(Points=[move_6.Geometry, move_4.Geometry])  # -> Points, Indices
sort_pt_2 = SortPoints(Points=[move_7.Geometry, move_5.Geometry])  # -> Points, Indices
intcrv_t = InterpolateT(Vertices=sort_pt.Points, Degree=3, TangentStart=Vector(0, 0, 0), TangentEnd=Vector(0, 0, 0), KnotStyle=1)  # -> Curve, Length, Domain
intcrv_t_2 = InterpolateT(Vertices=sort_pt_2.Points, Degree=3, TangentStart=Vector(0, 0, 0), TangentEnd=Vector(0, 0, 0), KnotStyle=1)  # -> Curve, Length, Domain
loft = Loft(
    Curves=[intcrv_t.Curve, intcrv_t_2.Curve],
    Options={Adjust=False, Closed=False, LoftEnds=0, LoftSimp=0, LoftType=0, Rebuild=10, Refit=0.01})
mesh_uv = MeshSurface(Surface=loft, UCount=detail, VCount=detail, Overhang=True, Equalize=False)
yz = YZPlane(Origin=Point(0, 0, 0))
rotate_4 = Rotate(Geometry=mesh_uv, Angle=rotate_3, Plane=yz)  # -> Geometry, Transform
xz = XZPlane(Origin=Point(0, 0, 0))
rotate_5 = Rotate(Geometry=rotate_4.Geometry, Angle=rotate, Plane=xz)  # -> Geometry, Transform
xy = XYPlane(Origin=Point(0, 0, 0))
rotate_6 = Rotate(Geometry=rotate_5.Geometry, Angle=rotate_2, Plane=xy)  # -> Geometry, Transform
xy_2 = XYPlane(Origin=Point(0, 0, 0))
project = Project(Geometry=rotate_6.Geometry, Plane=xy_2)  # -> Geometry, Transform
bake_me = Geometry(project.Geometry)
